# Grasshopper definition ghhops-cpython-test.gh (Grasshopper 1.0.7)
# plug-ins: Hops

cir = Circle(Plane=PlaneXY(0, 0, 0), Radius=Slider(10, range=0..10))
hops = Hops(
    Curve=cir,
    T=Slider(46, range=0..100),
    CacheResultsInMemory=False,
    CacheSolveResults=False,
    RemoteDefinitionLocation="http://127.0.0.1:5000/pointat",
    RemoteSolveVersion=(0, 1, 0))
panel = Panel(hops)
